# Grasshopper definition TopologyPolyEdge.gh (Grasshopper 1.0.7)
# plug-ins: LunchBox, Sandbox Topology

# © 2013 by Tobias Schwinn
number_slider = Slider(0.001, range=0..1)
crv = Curve([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])
edge = Slider(7, range=0..47)
poly_topo_edge = PolygonTopologyEdge(ListOfPolylines=crv, Tolerance=number_slider)  # -> ListOfEdges, LoopEdgeStructure, EdgeLoopStructure
pcen = PolygonCenter(Polyline=crv)  # -> CenterV, CenterE, CenterA
branch = TreeBranch(Tree=simplify(poly_topo_edge.EdgeLoopStructure), Path=edge, MaintainPaths=True)
eval = EvaluateLength(Curve=poly_topo_edge.ListOfEdges, Length=0.5, Normalized=True)  # -> Point, Tangent, Parameter
points = PointList(Points=pcen.CenterV, Tags=True, Lines=False, Size=20)
ef = Panel(branch)
item = ListItem(List=poly_topo_edge.ListOfEdges, Index=edge, Wrap=True)
item_2 = ListItem(List=crv, Index=branch, Wrap=True)
points_2 = PointList(Points=eval.Point, Tags=True, Lines=False, Size=15)
pipe = Pipe(Curve=item, Radius=10, Caps=0)
patch = PatchSurface(EdgeCurves=graft(item_2), U=5, V=5, Tolerance=0.001)
